# Grasshopper definition grasshopper与rhino交互.gh (Grasshopper 0.9.76)

c_script = CSharpScript(x=Button())  # -> out, A; inputs x: Boolean
# ---------- c_script: C# ----------
    int value = 100;
    if(!x)
    {
      Rhino.Input.Custom.GetOption go = new Rhino.Input.Custom.GetOption();
      go.SetCommandPrompt("TriState value");
      go.AcceptNothing(true);
      go.AddOption("True");
      go.AddOption("False");
      go.AddOption("Unknown");


      switch (go.Get())
      {
        case Rhino.Input.GetResult.Option:
          if (go.Option().EnglishName == "True") { value = 1; }
          if (go.Option().EnglishName == "False") { value = 0; }
          if (go.Option().EnglishName == "Unknown") { value = -1; }
          break;
      }
    }

    A = value;
# ---------- end c_script ----------
panel = Panel(c_script.A)
panel_2 = Panel(c_script.out)
