# Grasshopper definition mouse_py.gh (Grasshopper 0.9.76)
# plug-ins: Python Interpreter

timer = Timer(TimerInterval=20, Target=getmousepts)
getmousepts = PythonScript(toggle=Toggle(True))  # -> out, currentPoint, line
# ---------- getmousepts: Python ----------
import System
import Rhino as rc
import scriptcontext as sc
import Rhino.Display as rd



if toggle:
    mp = System.Windows.Forms.Control.MousePosition
    vpt = rc.RhinoDoc.ActiveDoc.Views.ActiveView.ActiveViewport
    line = vpt.ClientToWorld(rc.Geometry.Point2d(mp.X-66,mp.Y-147))
# ---------- end getmousepts ----------
srf = Surface(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)
mesh_uv = MeshSurface(Surface=srf, UCount="20", VCount="20", Overhang=True, Equalize=False)
line = Line(getmousepts.line)
blx = BrepLine(Brep=srf, Line=line, LimitToFirst=False)  # -> Curves, Points
faceb = FaceBoundaries(Mesh=mesh_uv)
pcen = PolygonCenter(Polyline=faceb)  # -> CenterV, CenterE, CenterA
null = NullItem(Item=blx.Points)  # -> NullFlags, InvalidFlags, Description
xy = XYPlane(Origin=Point(0, 0, 0))
cull = CullPattern(List=line, CullPattern=null.NullFlags)
plx = LinePlane(Line=cull, Plane=xy)  # -> Point, ParamL, ParamP
p_n_c = PickNChoose(Pattern=null.NullFlags, Stream0=blx.Points, Stream1=plx.Point)
dist = Distance(PointA=p_n_c, PointB=pcen.CenterV)
scale = Scale(Geometry=faceb, Center=pcen.CenterV, Factor="0.5")  # -> Geometry, Transform
explode = Explode(Curve=faceb, Recursive=True)  # -> Segments, Vertices
explode_2 = Explode(Curve=scale.Geometry, Recursive=True)  # -> Segments, Vertices
rulesrf = RuledSurface(CurveA=explode.Segments, CurveB=explode_2.Segments)
join = BrepJoin(Breps=rulesrf)  # -> Breps, Closed
smesh = SimpleMesh(Brep=join.Breps)
weld = WeldMesh(Mesh=smesh, Angle=3.141592654)
panel = Panel("""2
3
5
7""")
demesh = DeconstructMesh(Mesh=weld)  # -> Vertices, Faces, Colours, Normals
expression = Expression(x=dist, Expression="2/ (1 + x)")
item = ListItem(List=demesh.Vertices, Index=panel, Wrap=True)
scale_2 = Scale(Geometry=item, Center=graft(pcen.CenterV), Factor=graft(expression))  # -> Geometry, Transform
replace = ReplaceItems(List=demesh.Vertices, Item=scale_2.Geometry, Indices=panel, Wrap=False)
dist_2 = Distance(PointA=p_n_c, PointB=replace)
flatten = FlattenTree(Tree=dist_2, Path="{0}")
bnd = Bounds(Numbers=flatten)
remap = RemapNumbers(Value=dist_2, Source=bnd, Target=Domain(0, 1))  # -> Mapped, Clipped
gradient = Gradient(
    LowerLimit=0,
    UpperLimit=1,
    Parameter=remap.Mapped,
    stops=[0: RGB(234, 38, 0), 0.25: RGB(234, 126, 0), 0.5: RGB(254, 244, 84), 0.75: RGB(173, 203, 249), 1: RGB(75, 107, 169)])
conmesh = ConstructMesh(Vertices=replace, Faces=demesh.Faces, Colours=gradient)
