# Grasshopper definition 人流聚散05.gh (Grasshopper 0.9.76)
# plug-ins: Python Interpreter

number_slider = Slider(300, range=0..1000)
number_slider_2 = Slider(150, range=0..10000)
planesrf = PlaneSurface(Plane=PlaneXY(0, 0, 0), XSize=number_slider, YSize=number_slider_2)
wires = BrepWireframe(Brep=planesrf, Density=-1)
planesrf_2 = PlaneSurface(Plane=PlaneXY(17, 10, 0), XSize=Slider(263, range=0..1000), YSize=Slider(120, range=0..1000))
timer = Timer(TimerInterval=50, Target=python)
pop2d = Populate2D(Region=planesrf_2, Count=Slider(500, range=0..500), Seed=Slider(10, range=0..10))
crv = Curve([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])
pt = Point([Point(214, 81, 0), Point(134, 65, 0), Point(76, 107, 0)])
pt_2 = Point([Point(14, 88, 0), Point(38, 126, 0), Point(161, 44, 0), Point(251, 94, 0), Point(179, 95, 0)])
pt_3 = Point([Point(272, 28, 0), Point(103, 41, 0), Point(117, 136, 0), Point(89, 7, 0), Point(179, 141, 0)])
python = PythonScript(
    polylines=crv,
    pts=pop2d,
    ptcs_01=pt_2,
    ptcs_02=pt,
    ptcs_03=pt_3,
    box=planesrf,
    line_charge=Slider(10, range=0..10),
    charge_01=Slider(5, range=0..10),
    charge_02=Slider(8, range=0..10),
    charge_03=Slider(10, range=0..10),
    range_x=number_slider,
    range_y=number_slider_2,
    toogle=Toggle(False))  # -> out, pts, vecs; inputs polylines: list of Polyline, pts: list of Vector3d, ptcs_01: list of Vector3d, ptcs_02: list of Vector3d, ptcs_03: list of Vector3d, box: Box, toogle: Boolean
# ---------- python: Python ----------
#_*_coding:UTF-8_*_
#!/usr/bin/python

#Author :CPF
#Datatime :2017-07-03
#copyright
"""
这个电池将模拟人流在街道中，聚集，停滞，行走的状态，这只是一个不太精确模拟，
没有经过太长时间的考虑。限于运行速度，本想借着扩展，但算了吧。
"""

import random

import Rhino.Geometry as rg

from Grasshopper.Kernel.Types import GH_LineCharge
from Grasshopper.Kernel.Types import GH_PointCharge
from Grasshopper.Kernel.Types import GH_Field


class LineCharges:
    """
    用来存放封闭的线段，即街道中的墙体。墙体对于移动者有一定的排斥作用，
    但在线段内部的移动者受反向作用。
    """
    def __init__(self,polylines,box):
        """
        self.field 用于存放磁场的总值。
        """
        self.crvs = polylines
        self.field = LineCharges.get_field(polylines,box)

    @staticmethod
    def get_field(polylines,box):
        """
        声明一个静态方法，获取所有磁场的总和
        """
        L =[]
        lines_list = [polyline.GetSegments() for polyline in polylines]
        for row in lines_list:
            L.extend(row)
        
        gH_Field = GH_Field()
        for i in range(len(L)):
            gH_LineCharge =  GH_LineCharge()
            gH_LineCharge.Charge = line_charge  #磁场力大小
            gH_LineCharge.Limits = box
            gH_LineCharge.Segment = L[i]
            gH_Field.Elements.Add(gH_LineCharge.Duplicate())
        return gH_Field
    
    def force(self,mover):
        """
        在磁场中，移动者所收到的的力，在墙体外部收到排斥力，在墙体内部受方向力
        """
        pos = mover.pos
        #判断移动者是否在任何线段的内部.
        bools = (crv.Contains(rg.Point3d(pos.X,pos.Y,pos.Z)) for crv in self.crvs)
        if any(bools):
            force_acc = self.field.TensorAt(rg.Point3d(pos.X,pos.Y,pos.Z))
            mover.acc = rg.Vector3d.Subtract(mover.acc,force_acc)
        else:
            force_acc = self.field.TensorAt(rg.Point3d(pos.X,pos.Y,pos.Z))
            mover.acc = rg.Vector3d.Add(mover.acc,force_acc)
            
        
        
class PointCharge:
    """
    用来存放封闭的线段，即街道中的墙体。墙体对于人流有一定的排斥作用，
    但在线段内部的点不受排斥作用。
    """
    def __init__(self,pt,charge,box):
        """
        self.field 用于存放磁场的值。
        self.names 用来存放已经来过移动者，来过的移动者，不会对他们产生吸引力
        """
        self.pt_cha= pt
        self.charge = charge
        self.field = PointCharge.get_field(pt,charge,box)
        self.names = set()
        
    @staticmethod
    def get_field(vec,charge,box):
        """
        获取所有点的磁场。
        """
        gH_PointCharge = GH_PointCharge();
        gH_PointCharge.Location =rg.Point3d(vec.X,vec.Y,vec.Z);
        gH_PointCharge.Charge = -1*charge;
        #磁场力与距离的平方成反比（猜测的）
        gH_PointCharge.Decay = 2;
        gH_PointCharge.Limits = box 
        return gH_PointCharge
        
        
    def force(self,mover):
        """
        吸引点对移动者具有吸引力，但是，已经到达过的地方将不会，在产生吸引力，
        同时移动者根据喜好不同，在一定情况下，下一时刻可能随时离开。
        """
        if mover.name in self.names:
            pass    #如果已经去过了，将不会再去
        else:
            vec = mover.pos
            force_acc = self.field.Force(rg.Point3d(vec.X,vec.Y,vec.Z))
            mover.acc = rg.Vector3d.Add(force_acc,mover.acc)
            #在一定范围内，移动者停留的的时间，会进行增加，当超过某个值的时候
            #店铺将不会对此移动者再产生吸引力
            dis = rg.Vector3d.Subtract(self.pt_cha,mover.pos).Length
            if  dis < 5:
                mover.stay +=1
                if mover.stay > 40:
                    self.names.add(mover.name)
            """
            elif len(self.names) >300:
                self.names.clear()
            """
            if dis > 15:
                """
                当停留时间不够长时，同时已经离开一定距离，那么重新将他的状态值
                设置为0，这样可以面对两种情况，一种是移动者可能仅仅是路过，那么他
                可能会回头逛，还有就是它面对另外一个吸引点时，它的状态值应该为0
                """
                self.stay = 0

        
class Mover:
    """
    模拟人特征,相互靠拢,走向店铺,逛过的,不会再逛.
    """
    ID = 0
    def __init__(self,pos):
        self.pos = pos
        self.name = "%d"% Mover.ID      #每一个移动者都一个不一样的名字
        self.stay = 0       #停留值，即停留时间
        self.vec = rg.Vector3d(0,0,0)
        self.acc = rg.Vector3d(0,0,0)
        Mover.ID += 1
        
    def wind(self):
        """
        人的运动具有一定的随机性，产生一个随机移动值
        """
        a=random.randint(-1,1)/10    #这个函数是产生-0.1到0.1之间的随机数。
        b=random.randint(-1,1)/10
        vec=rg.Vector3d(a,b,0)
        self.vec=rg.Vector3d.Add(self.vec,vec)  #随机摆动
        
    #这个方法没有调用过，毕竟速度已经跟不上，所以可能有错。
    def attraction(self,movers,dis):
        """
        人群之间在一定距离内具有一定的吸引力，
        """
        acc = rg.Vector3d(0,0,0)
        for i in range(len(movers)):
            sub_vec = rg.Vector3d.Subtract(mover.pos - self.pos)
            length = sub_vec.Lenght
            if 2 < length  < dis :
                sub_vec.Unitize()
                #距离越近,吸引力越大,呈现线性相关
                vec = rg.Vector3d.Multiply(sub_vec,dis - length)
                acc = rg.Vector3d.Add(acc,vec)
        self.acc = rg.Vector3d.Add(acc,self.acc)    #更新吸引力
        
    def reject(self,movers):
        """
        人群之间在一定距离内具有一定的排斥力，
        """
        acc = rg.Vector3d(0,0,0)
        for i in range(len(movers)):
            sub_vec = rg.Vector3d.Subtract(self.pos,movers[i].pos)
            length = sub_vec.Length
            if length < 2:      #人群之间的距离小于2时，产生排斥力
                sub_vec.Unitize()
                vec = rg.Vector3d.Multiply(sub_vec,2)
                acc = rg.Vector3d.Add(vec,acc)
        self.vec = rg.Vector3d.Add(acc,self.vec)
        
    def limited(self,max):
        """
        将速度限制在一定的范围之内，不能运行的太快了
        """
        length = self.acc.Length
        if length > max :
            self.acc.Unitize()  #单位化加速度
            
        self.vec =rg.Vector3d.Add(self.vec,self.acc)
        length = self.vec.Length
        if length > max :
            self.vec.Unitize()
            self.vec = rg.Vector3d.Multiply(self.vec,max)
        
    def check_edge(self,x,y):
        """
        移动者如果，穿过边界，那么，他会死去，然后有新的移动者在对面的边界出现,
        这里是通过名字的改变，而不是重新生成一个移动者。
        """
        if self.pos[0] < 0:
            self.pos[0] = x
            Mover.ID +=1
            self.names = "%d"% Mover.ID
        if self.pos[0] > x:
            self.pos[0] = 0
            Mover.ID +=1
            self.names = "%d"% Mover.ID
        if self.pos[1] < 0:
            self.pos[1] = y
            Mover.ID +=1
            self.names = "%d"% Mover.ID
        if self.pos[1] > y:
            self.pos[1] = 0
            Mover.ID +=1
            self.names = "%d"% Mover.ID

    def update(self):
        """
        更新移动者运动的状态。
        """
        self.wind()
        self.limited(1)
        self.check_edge(range_x,range_y)
        self.pos = rg.Vector3d.Add(self.pos,self.vec)   #更新位置


class Engine:
    """
    定义一个引擎,用来初始化移动者,墙,吸引点,和驱动整个程序的运行
    """
    def __init__(self,pts):
        """
        param:
            self.movers是一个列表，用来存放所有的 Mover
            self.lcs 用来存放具有排斥力的 LineCharges
            self.ptcs 用来存放具有吸引力的 PointCharge
        """
        self.movers = Engine.creat_movers(pts)
        self.lcs = LineCharges(polylines,box)
        self.ptcs = Engine.creat_ptcs(ptcs_01,charge_01,box)+\
                    Engine.creat_ptcs(ptcs_02,charge_02,box)+\
                    Engine.creat_ptcs(ptcs_03,charge_03,box)
        
    @staticmethod
    def creat_movers(pts):
        L = []
        for i in range(len(pts)):
            mover = Mover(pts[i])
            L.append(mover)
        return L
        
    @staticmethod
    def creat_ptcs(ptcs,charge,box):
        """
        通过类的静态方法，来初始化吸引点，类的静态方法和一般的函数没什么区别，
        之所以不在类的外部定义函数，也许仅仅是为了表明这个方法和这个类有关。
        """
        L = []
        for i in range(len(ptcs)):
            ptc = PointCharge(ptcs[i],charge,box)
            L.append(ptc)
        return L
        
    def apply_line_charges(self):
        """
        将墙体的排斥力施加在移动者上
        """
        for mover in self.movers:
            self.lcs.force(mover)
        
    def apply_point_charges(self):
        """
        将点源的吸引力施加在移动者上
        """
        for ptc in self.ptcs:
            for mover in self.movers:
                ptc.force(mover)
        
    def update_movers(self):
        """
        更新所有移动者的状态值
        """
        self.apply_point_charges()
        for mover in self.movers:
            mover.acc.Unitize()

        self.apply_line_charges()
        for mover in self.movers:
            mover.update()
            mover.reject(self.movers)
            mover.acc =rg.Vector3d(0,0,0)
        
    def get(self):
        """
        以元组形式返回，移动者的位置和方向
        """
        pts = [mover.pos for mover in self.movers]
        vecs =[mover.vec for mover in self.movers]
        return pts,vecs
    
if toogle:
    engine = Engine(pts)

else:
    engine.update_movers()
    result = engine.get()
    pts = result[0]
    vecs = result[1]
# ---------- end python ----------
merge = Merge(Data1=pt_2, Data2=pt, Data3=pt_3)
sph = Sphere(Base=merge, Radius=Slider(5, range=0..10))
trim = TrimWithRegion(Curve=crv, Region=planesrf)  # -> Inside, Outside
crv_2 = Curve(trim.Inside)
incurves = PointInCurves(Point=python.pts, Curves=crv)  # -> Relationship, Index, Point
con = DelaunayEdges(Points=python.pts, Plane=PlaneXY(0, 0, 0))  # -> Connectivity, Edges
item = ListItem(List=python.pts, Index=0, Wrap=True)
dispatch = Dispatch(List=python.pts, DispatchPattern=incurves.Relationship)  # -> ListA, ListB
rec = DataRecorder(item, DataLimit=-10, RecordData=True)
cloud = CloudDisplay(Points=dispatch.ListB, Colours=ColourSwatch(SwatchColor=RGB(229, 47, 255)), Size=Slider(2, range=0..10), SpriteType=0)
path = DataPath()
pline = PolyLine(Vertices=rec, Closed=False)
panel = Panel(rec)
panel_2 = Panel(pline)
