# Grasshopper definition 八皇后.gh (Grasshopper 0.9.76)
# plug-ins: Python Interpreter

number_slider = Slider(9, range=0..10)
number_slider_2 = Slider(10, range=0..10)
python = PythonScript(num=number_slider)  # -> out, a; inputs num: Int32
# ---------- python: Python ----------
import rhinoscriptsyntax as rs

def queens(num=8,state=()):
    for pos in range(num):
        if not conflict(state,pos):
            if len(state)==num-1:
                yield (pos,)
            else :
                for result in queens(num,state+(pos,)):
                    yield (pos,)+result
                    
                    
def conflict(state,nextX):
    nextY=len(state)
    for i in range(nextY):
        if abs(state[i]-nextX) in (0,nextY-i):
            '''
            如果下一个皇后和正在考虑的前一个给皇后的水平距离为0，
            （列相同）或者等于垂直距离（在同一条对角线上）就返回True，否者返回False。
            '''
            
            return True
    return False
        
a=queens(num)
# ---------- end python ----------
item = ListItem(List=python.a, Index=Slider(100, range=0..100), Wrap=True)
sqgrid = Square(Plane=PlaneXY(0, 0, 0), Size=Slider(9, range=0..10), ExtentX=number_slider, ExtentY=number_slider)  # -> Cells, Points
python_2 = PythonScript(x=item)  # -> out, graft(a)
# ---------- python_2: Python ----------
a=list(x)
# ---------- end python_2 ----------
item_2 = ListItem(List=sqgrid.Cells, Index=python_2.a, Wrap=True)
srf = Surface(item_2)
