# Grasshopper definition 关于地形整理的.gh (Grasshopper 0.9.76)
# plug-ins: Python Interpreter

迭代次数 = Slider(10, range=0..10)
雨量 = Slider(2000, range=0..10000)
# 雨水路径分析
需要分析mesh = Mesh(<mesh referenced from the Rhino model>)
Z = UnitZ(Factor=50)
box = Box(需要分析mesh)
move = Move(Geometry=box, Motion=Z)  # -> Geometry, Transform
pop3d = Populate3D(Region=move.Geometry, Count=雨量, Seed=1)
project = ProjectPoint(Point=pop3d, Direction=Vector(0, 0, -1), Geometry=需要分析mesh)  # -> Point, Index
clean = CleanTree(RemoveNulls=True, RemoveInvalid=True, RemoveEmpty=False, Tree=project.Point)
python = PythonScript(point=clean, mesh=需要分析mesh, gen=迭代次数)  # -> out, points, curve; inputs point: Point3d, mesh: Mesh, gen: Int32
# ---------- python: Python ----------
#作者：CPF
#时间：2016/12/30

import Rhino.Geometry as rg
import rhinoscriptsyntax as rs

#定义了一个函数，描述数据如何进行处理
def fun_01(point,mesh):
    mesh_point = mesh.ClosestMeshPoint(point,0.001)
    #得到point在mesh上的法线方向
    vector_01= mesh.NormalAt(mesh_point)
    vector_Z = rg.Vector3d.ZAxis
    #构建平面
    plane = rg.Plane(point,vector_01)
    #求出Z 轴与平面X轴的角度
    degree = rg.Vector3d.VectorAngle(vector_Z,plane.XAxis,plane)
    plane.Rotate(-degree,vector_01,point)
    #得到需要移动的反方向
    vector = plane.XAxis
    
    point = point - vector
    point = mesh.ClosestPoint(point)
    return point
    
def fun(point,mesh,gen):
    i = 0
    while i < gen:
        i=i+1
        point = fun_01(point,mesh)
        yield point
        
rt_list = [point]
points = list(fun(point,mesh,gen))
curve = rs.AddPolyline(points)
# ---------- end python ----------
python_2 = PythonScript(point=clean, mesh=需要分析mesh, gen=迭代次数)  # -> out, points, curve; inputs point: Point3d, mesh: Mesh, gen: Int32; disabled
# ---------- python_2: Python ----------
#作者：CPF
#时间：2016/12/26
#一元谓词的用法，以迭代模型为例。

#导入所需要的函数库
from functools import partial
import Rhino.Geometry as rg
from Grasshopper.Kernel.Data import GH_Path
from Rhino.Geometry import GeometryBase
from Grasshopper import DataTree
import rhinoscriptsyntax as rs
from collections import deque

#定义一个迭代器模型,
def recursion(re_list,rt_list,gen,fun):
    """
    Parameters:
        re_list:每次需要计算的数据
        rt_list:每次迭代计算的累计结果，[[],[],[]]数据结构为嵌套列表
        gen:需要迭代的次数
        fun:一元谓词，数据是如何进行迭代
    Retrun:
        返回一个树形数据，每一个树枝存放一次迭代结果
    """
    if gen == 0:
        #返回一个树形数据，存放的为object,object为所有类的基类。
        return rt_list     #返回迭代结果
    else:
        #调用fun函数
        re_list = fun(re_list)
        rt_list.append(re_list)
        #进入下一迭代。
        return recursion(re_list,rt_list,gen-1,fun)
        
#定义了一个函数，描述数据如何进行处理
def fun_01(point,mesh):
    mesh_point = mesh.ClosestMeshPoint(point,0.001)
    #得到point在mesh上的法线方向
    vector_01= mesh.NormalAt(mesh_point)
    vector_Z = rg.Vector3d.ZAxis
    #构建平面
    plane = rg.Plane(point,vector_01)
    #求出Z 轴与平面X轴的角度
    degree = rg.Vector3d.VectorAngle(vector_Z,plane.XAxis,plane)
    plane.Rotate(-degree,vector_01,point)
    #得到需要移动的反方向
    vector = plane.XAxis
    
    point = point - vector
    point = mesh.ClosestPoint(point)
    return point
    
    
    

rt_list = deque(maxlen =5)
rt_list.append(point)
fun = partial(fun_01,mesh = mesh)
points = recursion(point,rt_list,gen,fun)
curve = rg.Polyline(points)
# ---------- end python_2 ----------
crv = Curve(python.curve)

# ---- group: 拾取高程点生成模型
模型生成范围 = Rectangle({Plane=PlaneXY(545169.4743, 3937610.925, 0), Size=Domain2(u=0..2668.487664, v=0..2687.285533)})
# 拾取高程点生成模型
拾取高程点 = Guid([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])
读取文字 = CSharpScript(x=拾取高程点)  # -> out, strs, center; inputs x: Guid
# ---------- 读取文字: C# ----------
    var obj = Rhino.RhinoDoc.ActiveDoc.Objects.Find(x);
    Rhino.DocObjects.TextObject text = obj as Rhino.DocObjects.TextObject;
    if (text != null)
    {
      string str = text.DisplayText;
      strs = str;
      Point3d point = text.Geometry.GetBoundingBox(true).Center;
      center = point;
    }
# ---------- end 读取文字 ----------
incurve = PointInCurve(Point=读取文字.center, Curve=模型生成范围)  # -> Relationship, Point
dispatch = Dispatch(List=读取文字.strs, DispatchPattern=incurve.Relationship)  # -> ListA, ListB
dispatch_2 = Dispatch(List=读取文字.center, DispatchPattern=incurve.Relationship)  # -> ListA, ListB
pdecon = Deconstruct(Point=dispatch_2.ListA)  # -> XComponent, YComponent, ZComponent
python_3 = PythonScript(x=pdecon.XComponent, y=pdecon.YComponent)  # -> a, b; inputs x: list, y: list
# ---------- python_3: Python ----------
a = min(x)
b = min(y)
a = [i - a for i in x]
b = [i - b for i in y]
# ---------- end python_3 ----------
pt = ConstructPoint(XCoordinate=python_3.a, YCoordinate=python_3.b, ZCoordinate=expr("x", dispatch.ListA))
del = DelaunayMesh(Points=pt, Plane=PlaneXY(0, 0, 0))

# ----
# 地面坡度分析
需要分析mesh_2 = Mesh(<mesh referenced from the Rhino model>)
图例 = Rectangle({Plane=PlaneXY(2885.054799, -28.3102883, 0), Size=Domain2(u=0..474.9960331, v=0..868.2723185)})
Z_2 = UnitZ(Factor=1)
range = Range(Domain=Domain(0, 1), Steps=10)
gradient = Gradient(LowerLimit=0, UpperLimit=1, Parameter=range, stops=[0: RGB(0, 128, 0), 0.5: RGB(255, 255, 0), 1: RGB(255, 0, 0)])

demesh = DeconstructMesh(Mesh=需要分析mesh_2)  # -> Vertices, Faces, Colours, Normals

meshcp = MeshClosestPoint(Point=demesh.Vertices, Mesh=需要分析mesh_2)  # -> Point, Index, Parameter
meval = MeshEval(Mesh=需要分析mesh_2, Parameter=meshcp.Parameter)  # -> Point, Normal, Colour
angle = Angle(VectorA=meval.Normal, VectorB=Z_2)  # -> Angle, Reflex
bnd = Bounds(Numbers=angle.Angle)
range_2 = Range(Domain=bnd, Steps=10)
remap = RemapNumbers(Value=angle.Angle, Source=bnd, Target=Domain(0, 1))  # -> Mapped, Clipped
gradient_2 = Gradient(LowerLimit=0, UpperLimit=1, Parameter=remap.Mapped, stops=[0: RGB(0, 128, 0), 0.5: RGB(255, 255, 0), 1: RGB(255, 0, 0)])
legend = Legend(Colour=reverse(gradient), Tags=reverse(range_2), Rectangle=图例, LegendType=1)
meshcolor = Meshcolor(mesh=需要分析mesh_2, color=gradient_2)  # -> out, A; inputs mesh: Mesh, color: list of Color
# ---------- meshcolor: C# ----------
    for (int i = 0 ;i < mesh.Vertices.Count ;i++)
    {
      if (color.Count > 1)
      {
        mesh.VertexColors.SetColor(i, color[i]);
      }
      else
      {
        mesh.VertexColors.SetColor(i, color[0]);
      }
    }
    A = mesh;
# ---------- end meshcolor ----------

# ----
# 高程分析
需要分析mesh_3 = Mesh(<mesh referenced from the Rhino model>)
图例_2 = Rectangle({Plane=PlaneXY(56.00471449, -45.62090907, 0), Size=Domain2(u=0..10.22643756, v=0..22.53012025)})
range_3 = Range(Domain=Domain(0, 1), Steps=10)
gradient_3 = Gradient(LowerLimit=0, UpperLimit=1, Parameter=range_3, stops=[0: RGB(0, 128, 0), 0.5: RGB(255, 255, 0), 1: RGB(255, 0, 0)])

demesh_2 = DeconstructMesh(Mesh=需要分析mesh_3)  # -> Vertices, Faces, Colours, Normals

pdecon_2 = Deconstruct(Point=demesh_2.Vertices)  # -> XComponent, YComponent, ZComponent
bnd_2 = Bounds(Numbers=pdecon_2.ZComponent)
remap_2 = RemapNumbers(Value=pdecon_2.ZComponent, Source=bnd_2, Target=Domain(0, 1))  # -> Mapped, Clipped
range_4 = Range(Domain=bnd_2, Steps=10)
gradient_4 = Gradient(
    LowerLimit=0,
    UpperLimit=1,
    Parameter=remap_2.Mapped,
    stops=[0: RGB(0, 128, 0), 0.5: RGB(255, 255, 0), 1: RGB(255, 0, 0)])
meshcolor_2 = Meshcolor(mesh=需要分析mesh_3, color=gradient_4)  # -> out, A; inputs mesh: Mesh, color: list of Color; same code as meshcolor
legend_2 = Legend(Colour=reverse(gradient_3), Tags=reverse(range_4), Rectangle=图例_2, LegendType=1)
