# Grasshopper definition 凤凰未写完.gh (Grasshopper 0.9.76)
# plug-ins: Python Interpreter

number_slider = Slider(45, range=0..100)
number_slider_2 = Slider(53, range=0..100)
number_slider_3 = Slider(73, range=0..1000)
number_slider_4 = Slider(25, range=0..100)
number_slider_5 = Slider(50, range=0..100)
python = PythonScript(x=number_slider_3, y=number_slider_2, z=number_slider, u=number_slider_4, v=number_slider_5, w=Slider(45, range=0..100))  # -> out, L, ellipses, pts; inputs y: Int32, w: Int32
# ---------- python: Python ----------
import rhinoscriptsyntax as rs
from Grasshopper.Kernel.Data import GH_Path
from Grasshopper import DataTree
from Rhino.Geometry import Point3d

mp=[]
sum=0
L=[]
pts=DataTree[Point3d]()
circle=rs.AddCircle(rs.WorldXYPlane(),x)
i=rs.CurveLength(circle)/y
while sum <=rs.CurveLength(circle):
    mp.append(sum)
    sum=sum+i
for m in mp:
    L.append(rs.CurvePerpFrame(circle,m))
ellipses=[]
s=0
for i in range(y+1):
    rotate=180/y
    ellipse=rs.AddEllipse(rs.RotatePlane(L[i],s,L[i].ZAxis),z,u)
    s=rotate+s
    ellipses.append(ellipse)
    dipoint=rs.DivideCurve(ellipse,w)
    pts.AddRange(dipoint,GH_Path(i))
# ---------- end python ----------
python_2 = PythonScript(x=number_slider_3, y=number_slider_2, z=number_slider, u=number_slider_4, v=number_slider_5)  # -> out, L, ellipses, mp; inputs y: Int32
# ---------- python_2: Python ----------
import rhinoscriptsyntax as rs
import math 

mp=[]
sum=0
L=[]
circle=rs.AddCircle(rs.WorldXYPlane(),x)
i=rs.CurveLength(circle)/y
while sum <=rs.CurveLength(circle):
    mp.append(sum)
    sum=sum+i
for m in mp:
    L.append(rs.CurvePerpFrame(circle,m))
ellipses=[]
s=0
for i in range(y+1):
    rotate=180/y
    ellipse=rs.AddEllipse(rs.RotatePlane(L[i],s,L[i].ZAxis),z,u)
    s=rotate+s
    ellipses.append(ellipse)
# ---------- end python_2 ----------
crv = Curve(python_2.ellipses)
lng = ListLength(List=crv)
lng_2 = ListLength(List=python.ellipses)
crv_2 = Curve(python.ellipses)
series = Series(Start=0, Step=1, Count=lng)  # -> graft(Series)
crv_3 = Curve(python.ellipses)
series_2 = Series(Start=0, Step=1, Count=lng_2)  # -> graft(Series)
divide = DivideCurve(Curve=crv, Count=Slider(12, range=0..100), Kinks=False)  # -> Points, Tangents, Parameters
shift = ShiftList(List=divide.Points, Shift=expr("-x", series), Wrap=True)
shift_2 = ShiftList(List=divide.Points, Shift=series, Wrap=True)
shift_3 = ShiftList(List=python.pts, Shift=expr("-x", series_2), Wrap=True)
shift_4 = ShiftList(List=python.pts, Shift=series_2, Wrap=True)
flip = FlipMatrix(Data=shift_2)
flip_2 = FlipMatrix(Data=shift)
flip_3 = FlipMatrix(Data=shift_4)
flip_4 = FlipMatrix(Data=shift_3)
intcrv = Interpolate(Vertices=flip, Degree=3, Periodic=False, KnotStyle=1)  # -> Curve, Length, Domain
intcrv_2 = Interpolate(Vertices=flip_2, Degree=3, Periodic=False, KnotStyle=1)  # -> Curve, Length, Domain
intcrv_3 = Interpolate(Vertices=flip_3, Degree=3, Periodic=False, KnotStyle=1)  # -> Curve, Length, Domain
intcrv_4 = Interpolate(Vertices=flip_4, Degree=3, Periodic=False, KnotStyle=1)  # -> Curve, Length, Domain
pipe = Pipe(Curve=intcrv.Curve, Radius=1, Caps=0)
pipe_2 = Pipe(Curve=intcrv_2.Curve, Radius=1, Caps=0)
pipe_3 = Pipe(Curve=intcrv_3.Curve, Radius=1, Caps=0)
pipe_4 = Pipe(Curve=intcrv_4.Curve, Radius=1, Caps=0)
