# Grasshopper definition 凸包算法.gh (Grasshopper 0.9.76)
# plug-ins: Python Interpreter

number_slider = Slider(346, range=0..1000)

pop2d = Populate2D(
    Region={Plane=PlaneXY(9.30038948, 7.598971428, 0), Size=Domain2(u=0..44.1055318, v=0..30.19532562)},
    Count=Slider(68, range=0..100),
    Seed=1)
python = PythonScript(pts=pop2d, y=Slider(7, range=0..10))  # -> out, a; inputs pts: list of Point3d, y: Int32
# ---------- python: Python ----------
import Rhino.Geometry as rg


pts = sorted(pts,key = lambda pt :(pt.Y,pt.X))
line = rg.Line(pts[0],pts[1])
ptsbool = [False for i in range(len(pts))]

def leftbool (line,point):
    vect01 = line.Direction
    endpt = line.PointAt(0)
    vect02 = endpt - point
    
    crossvect = rg.Vector3d.CrossProduct(vect02,vect01)
    if crossvect.Z > 0:
        return True
    else:
        return False
        
lines =[]
k =0
for j in range(len(pts)):
    startpt = pts[k]
    line = rg.Line(pts[k],pts[j])
    for i in range(len(pts)):
        if not(leftbool(line,pts[i])):
            if rg.Line(startpt,pts[i]).Length>0:
                line = rg.Line(startpt,pts[i])
                k = i
        
    lines.append(line)
a =lines
# ---------- end python ----------

pop2d_2 = Populate2D(
    Region={Plane=PlaneXY(9.30038948, 7.598971428, 0), Size=Domain2(u=0..44.1055318, v=0..30.19532562)},
    Count=Slider(400, range=0..1000),
    Seed=1)
python_2 = PythonScript(pts=pop2d)  # -> out, a; inputs pts: list of Point3d
# ---------- python_2: Python ----------
import Rhino.Geometry as rg

def leftbool (line,point):
    vect01 = line.Direction
    endpt = line.PointAt(0)
    vect02 = endpt - point
    
    crossvect = rg.Vector3d.CrossProduct(vect02,vect01)
    if crossvect.Z > 0:
        return True
    else:
        return False
        
k = 0
for i in  range(1,len(pts)):
    if pts[k].X > pts[i].X:
        k = i
        
#极点
startpt = pts[k]
line = rg.Line(pts[k],pts[k -1])
k = k-1

for i in range(len(pts)):
    if rg.Line(startpt,pts[i]).Length>0: 
        if not(leftbool(line,pts[i])):
            line = rg.Line(startpt,pts[i])
            k = i
            
#极边
a = rg.Line(startpt,pts[k])
# ---------- end python_2 ----------
python_3 = PythonScript(pts=pop2d_2, y=Slider(3, range=0..10))  # -> out, a; inputs pts: list of Point3d, y: Int32
# ---------- python_3: Python ----------
import Rhino.Geometry as rg


pts = sorted(pts,key = lambda pt :(pt.Y,pt.X))
line = rg.Line(pts[0],pts[1])
ptsbool = [False for i in range(len(pts))]

def leftbool (line,point):
    vect01 = line.Direction
    endpt = line.PointAt(0)
    vect02 = endpt - point
    
    crossvect = rg.Vector3d.CrossProduct(vect02,vect01)
    if crossvect.Z > 0:
        return True
    else:
        return False
        
lines =[]
k =0
bool = True
while bool== True:
    startpt = pts[k]
    line = rg.Line(pts[k],pts[k-1])
    for i in range(len(pts)):
        if not(leftbool(line,pts[i])):
            if rg.Line(startpt,pts[i]).Length>0:
                line = rg.Line(startpt,pts[i])
                k = i
    lines.append(line)
    if k == 0:
        bool = False
a =lines
# ---------- end python_3 ----------
hull = ConvexHull(Points=pop2d_2, Plane=PlaneXY(0, 0, 0))  # -> Hull, HullZ, Indices
pt = Point(pop2d_2)
pt_2 = Point(pop2d)
python_4 = PythonScript()  # -> Out, A
python_5 = PythonScript(x=Slider(1.344556, range=0..10), y=Slider(3, range=0..10))  # -> out, a; inputs y: Int32
# ---------- python_5: Python ----------
a = round(x,y)
# ---------- end python_5 ----------
number_slider_2 = Slider(50, range=0..100)
pop2d_3 = Populate2D(
    Region={Plane=PlaneXY(9.30038948, 7.598971428, 0), Size=Domain2(u=0..44.1055318, v=0..30.19532562)},
    Count=Slider(50, range=0..100),
    Seed=1)
con = DelaunayEdges(Points=pop2d_3, Plane=PlaneXY(0, 0, 0))  # -> Connectivity, Edges
reduce = RandomReduce(List=con.Edges, Reduction=number_slider_2, Seed=number_slider_2)
end = EndPoints(Curve=reduce)  # -> Start, End
cset = CreateSet(List=flatten([end.Start, end.End]))  # -> Set, Map
mindex = MemberIndex(Set=cset.Set, Member=end.End)  # -> flatten(Index), Count
mindex_2 = MemberIndex(Set=cset.Set, Member=end.Start)  # -> flatten(Index), Count
python_6 = PythonScript(pts=cset.Set, prank=mindex_2.Index, srank=mindex.Index)  # -> out, a
# ---------- python_6: Python ----------
class Node:
    def __init__(self,rank,point,edgs):
        self.rank = rank 
        self.point = point
        if edgs:
            self.edges = edges
        else:
            self.edges = []
        
    def addedge(self,edges):
        self.append(edges)

class Edges:
    def __init__(self,prank,srank,curve):
        self.prank = prank
        self.srank = srank
        self.curve = curve
# ---------- end python_6 ----------
panel = Panel(mindex_2.Index)
python_7 = PythonScript(pts=cset.Set, prank=mindex_2.Index, srank=mindex.Index, lines=reduce)  # -> out, a; inputs pts: list of Point3d, prank: list, srank: list, lines: list of Line
# ---------- python_7: Python ----------
class Node:
    def __init__(self,rank,point):
        self.rank = rank 
        self.point = point
        self.edges = []
        
    def addedge(self,edges):
        self.append(edges)

class Edge:
    def __init__(self,prank,srank,curve):
        self.prank = prank
        self.srank = srank
        self.curve = curve
        self.bool =False
        
        
edges = []
for i in range(len(lines)):
    edge = Edge(prank[i],srank[i],lines[i])
    edges.append(edge)
    edge = Edge(srank[i],prank[i],lines[i])
    edges.append(edge)
    
nodes = []
for i in range(len(pts)):
    node = Node(i , pts[i])
    nodes.append(node)
    
for i in range(len(lines)):
    edge = Edge(prank[i],srank[i],lines[i])
    edges.append(edge)
    for k in range(len(nodes)):
        if prank[i] == k:
            nodes[k].edges.append(edge)
            
    edge = Edge(srank[i],prank[i],lines[i])
    for k in range(len(nodes)):
        if srank[i] == k:
            nodes[k].edges.append(edge)
    edges.append(edge)
    
    
k = 0
for i in range(len(pts)):
    if pts[i].X <pts[k].X:
        k = i
a = pts[k]
# ---------- end python_7 ----------
