# Grasshopper definition 改变slider的数值.gh (Grasshopper 0.9.76)
# plug-ins: Python Interpreter

panel = Panel("job")  # disabled
ery = Slider(4, range=0..10)
job = Slider(2, range=0..10)
job_2 = Slider(2, range=0..10)
job_3 = Slider(2, range=0..10)
ertyyu = Slider(4, range=0..10)
trte = Slider(6, range=0..10)
changeslider = PythonScript(num=Slider(2, range=0..10), nikeName=panel)  # -> out, a
# ---------- changeslider: Python ----------
from Grasshopper.Kernel.Special import GH_NumberSlider
from Grasshopper.Kernel import GH_RuntimeMessageLevel

ghenv.Component.Message = "改变Slider的值"
                
if True:
    #获取当前Grasshopper文档
    doc = ghenv.Component.OnPingDocument()
    #获取当前文档上的电池
    sel_objs = doc.Objects
    #如果没有电池打印错误
    if len(sel_objs)==0:
        ghenv.Component.AddRuntimeMessage(GH_RuntimeMessageLevel.Warning,"没有选择电池")
    #遍历当前的电池
    
    for sel_obj in sel_objs:
        #判断当前电池是不是GH_NumberSlider
        if type(sel_obj) is GH_NumberSlider:
            #判断电池的匿名是不是与输入的名称相匹配。
            if sel_obj.ImpliedNickName == nikeName:
                #改变电池的数值
                sel_obj.SetSliderValue(num)
# ---------- end changeslider ----------

number_slider = Slider(4, range=0..10)  # disabled
panel_2 = Panel("job")  # disabled
num = Number()
c_script = CSharpScript()  # -> out, A
# ---------- c_script: C# ----------
    System.Collections.Generic.List<Grasshopper.Kernel.IGH_ActiveObject> obj = this.GrasshopperDocument.ActiveObjects();
    int a = obj.Count();
    A = a;
    Print(obj.Count().ToString());
# ---------- end c_script ----------
number_slider_2 = Slider(4, range=0..10)  # disabled
shader = Shader()
python = PythonScript(x=number_slider, y=panel_2)  # -> out, a; disabled
# ---------- python: Python ----------
import clr
from Grasshopper.Kernel import Components

import System.Reflection as sr
import System as sy
import ghpythonlib.components as gc
from Grasshopper.Kernel.Special import GH_NumberSlider
#clr.AddReferenceToFileAndPath("D:\\Desktop\\个人的\\Box2DX-2.0.1.3-r175-RC-DemoSuite\\Box2DX.dll")

from Grasshopper.Kernel import GH_ParamWireDisplay
from Grasshopper.Kernel import GH_RuntimeMessageLevel

wire_display = {'0':GH_ParamWireDisplay.default,
                '1':GH_ParamWireDisplay.faint,
                '2':GH_ParamWireDisplay.hidden}
                
if True:
    doc = ghenv.Component.OnPingDocument()
    #sel_objs = doc.SelectedObjects()
    sel_objs = doc.Objects
    if len(sel_objs)==0:
        ghenv.Component.AddRuntimeMessage(GH_RuntimeMessageLevel.Warning,"没有选择电池")
        print len(sel_objs)
    for sel_obj in sel_objs:
        if type(sel_obj) is GH_NumberSlider:
            if sel_obj.NickName == y:
                sel_obj.SetSliderValue(x)
                print "凤飞飞"
# ---------- end python ----------
panel_3 = Panel(c_script.A)
python_2 = PythonScript()  # -> out, a; disabled
# ---------- python_2: Python ----------
a = [1,2,3]
b = [3]

print id(a)
a+=b

print id(a)
a = a+b

print id(a)

print ghenv
# ---------- end python_2 ----------

number_slider_3 = Slider(7, range=0..10)  # disabled
number_slider_4 = Slider(1, range=0..10)  # disabled
number_slider_5 = Slider(9, range=0..10)  # disabled
number_slider_6 = Slider(4, range=0..10)  # disabled
panel_4 = Panel("job")  # disabled
series = Series(Start=0, Step=1, Count=10)  # disabled
python_3 = PythonScript(x=number_slider_6, z=number_slider_5, u=number_slider_4, v=number_slider_3, y=panel_4)  # -> out, a
# ---------- python_3: Python ----------
from Grasshopper.Kernel.Special import GH_NumberSlider
from Grasshopper.Kernel import GH_RuntimeMessageLevel
from Grasshopper.Kernel.Special import GH_GraphMapper

                
if True:
    doc = ghenv.Component.OnPingDocument()
    sel_objs = doc.Objects
    if len(sel_objs)==0:
        ghenv.Component.AddRuntimeMessage(GH_RuntimeMessageLevel.Warning,"没有选择电池")
        print len(sel_objs)
    for sel_obj in sel_objs:
        if type(sel_obj) is GH_GraphMapper:
            print sel_obj.NickName
            if sel_obj.NickName == y:
                sel_obj.Container.X0 = x
                sel_obj.Container.X1 = z
                sel_obj.Container.Y0 = u
                sel_obj.Container.Y1 = v
# ---------- end python_3 ----------
graph = GraphMapper(series, x0=0, x1=1, y0=0, y1=1, container_name="Bezier", cpx=[0, 0.25, 0.75, 1], cpy=[0, 0.25, 0.75, 1])  # disabled
job_4 = GraphMapper(
    series,
    x0=4,
    x1=9,
    y0=1,
    y1=7,
    container_name="Bezier",
    cpx=[0, 0.1863188744, 0.8838261962, 1],
    cpy=[0, 0.4576231241, 0.5726376772, 1])  # disabled

number_slider_7 = Slider(4, range=0..10)  # disabled
panel_5 = Panel("x")  # disabled
cs = ChangeSlider(
    num=number_slider_7,
    nickName=panel_5,
    Reference="C:\Users\Administrator\AppData\Roaming\Grasshopper\Libraries\ghpython.gha")  # -> out; inputs num: Double, nickName: String
# ---------- cs: C# ----------
    //获取当前Grasshopper文档上的组件
    IList<Grasshopper.Kernel.IGH_DocumentObject> a = this.GrasshopperDocument.Objects;
    //遍历当前文档上的组件
    for (int i = 0 ;i < a.Count();i++)
    {
      if (a[i].GetType().ToString() == "Grasshopper.Kernel.Special.GH_NumberSlider")
      {
        //执行拆箱操作，
        Grasshopper.Kernel.Special.GH_NumberSlider slider = a[i] as Grasshopper.Kernel.Special.GH_NumberSlider;
        //判断组件的匿名是否与输入的参数相匹配
        if (slider.ImpliedNickName == nickName)
        {
          slider.SetSliderValue((decimal) num);
        }
      }
    }
    this.Component.Name = "ChangeSlider";
    this.Component.NickName = "CS";
    this.Component.Message = "改变Slider的数值";
    this.Component.Description = "通过Slider的名称改变Slider的数值";
# ---------- end cs ----------
panel_6 = Panel(cs)  # disabled

number_slider_8 = Slider(4, range=0..10)  # disabled
c_script_2 = CSharpScript(x=number_slider_8, Reference="C:\Users\Administrator\AppData\Roaming\Grasshopper\Libraries\ghpython.gha")  # -> out, A; inputs x: Double; disabled
# ---------- c_script_2: C# ----------
    IList<Grasshopper.Kernel.IGH_DocumentObject> a = this.GrasshopperDocument.Objects;
    if (a.Count() == 0)
    {
      Print("gdfh");
    }
    for (int i = 0 ;i < a.Count();i++)
    {
      Print(a[i].GetType().ToString());
    }
    A = a;
# ---------- end c_script_2 ----------
panel_7 = Panel(c_script_2.out)  # disabled
panel_8 = Panel(c_script_2.A)  # disabled
c_script_3 = CSharpScript(Reference="C:\Users\Administrator\AppData\Roaming\Grasshopper\Libraries\ghpython.gha")  # -> out, A; disabled
# ---------- c_script_3: C# ----------
    Grasshopper.Kernel.GH_Document ghd = new Grasshopper.Kernel.GH_Document();
    Print(ghd.ToString());
    System.Collections.Generic.IList<IGH_ActiveObject> doc = ghd.ActiveObjects();
    int b = doc.Count();

    GrasshopperDocument = GhPython.DocReplacement.GrasshopperDocument;
    A = b;
# ---------- end c_script_3 ----------
c_script_4 = CSharpScript(Reference="C:\Users\Administrator\AppData\Roaming\Grasshopper\Libraries\ghpython.gha")  # -> out, A; disabled
# ---------- c_script_4: C# ----------
    GrasshopperDocument gd = new GhPython.DocReplacement.GrasshopperDocument();
    CustomTable obj = gd.Objects;
    GH_Component = GhPython.Component.PythonEnvironment();
    Print(obj.ToArray().Count().ToString());
    A = obj;
# ---------- end c_script_4 ----------
panel_9 = Panel(c_script_3.A)  # disabled
panel_10 = Panel(c_script_4.A)  # disabled
panel_11 = Panel(c_script_3.out)  # disabled
panel_12 = Panel(c_script_4.out)  # disabled
