# Grasshopper definition 数据映射.gh (Grasshopper 0.9.76)
# plug-ins: Python Interpreter

panel = Panel("""True
False
False
True
True
True
False
False""")
python = PythonScript(x=panel)  # -> out, a; inputs x: list
# ---------- python: Python ----------
from Grasshopper.Kernel.Data import GH_Path
from Grasshopper import DataTree

a = DataTree[object]()
lst = [x[0]]

k = 0 
a.Add(x[0],GH_Path(k,0))
for i in range(1,len(x)):
    if lst[-1] == x[i]:
        lst.append(x[i])
        a.Add(x[i],GH_Path(k,i))
    else:
        k =k+1
        lst =[x[i]]
        a.Add(x[i],GH_Path(k,i))
# ---------- end python ----------
path_mapper = PathMapper(python.a, source="{A;B}(i)", target="{A}(B)")
panel_2 = Panel(path_mapper)
