# Grasshopper definition 最大最小互换.gh (Grasshopper 0.9.76)
# plug-ins: Python Interpreter

series = Series(Start=0, Step=1, Count=5)
series_2 = Series(Start=0, Step=1, Count=5)
jitter = Jitter(List=series_2, Jitter=1, Seed=2)  # -> Values, Indices
changelist = Changelist(List=jitter.Values)  # -> out, changeList; inputs List: list
# ---------- changelist: Python ----------
#_*_coding:utf_8
#这样就可以做中文注释了，哈哈哈哈
"""
    这里是做的最大与最小值的互换，用到的sorted的方法，
    采用的的字典的排序，利用多次转换。
"""
def sort_Reverse(List):
    
    dic={}
    
    sort_List=sorted(List)
    for i in range(len(List)):
        dic[sort_List[i]]=List[i]

    dic2=sorted(dic.iteritems(), key=lambda d:d[1], reverse = True )#这是一个列表元组
    
    dic3={}
    for i in range(len(List)):
        dic3[sort_List[i]]=dic2[i][0]
        
    dic3=sorted(dic3.iteritems(), key=lambda d:d[1], reverse = False )
    
    List2=[]
    for i in range(len(List)):
        List2.append(dic3[i][0])
    return List2
changeList=sort_Reverse(List)
# ---------- end changelist ----------
panel = Panel(changelist.changeList)
