# Grasshopper definition 漫游.gh (Grasshopper 0.9.76)

number_slider = Slider(0.7296, range=0..1)
crv = Curve(<curve referenced from the Rhino model>)
eval = EvaluateCurve(Curve=reparameterize(crv), Parameter=number_slider)  # -> Point, Tangent, Angle
addition = Addition(A=Slider(0.23, range=0..1), B=number_slider)
pdecon = Deconstruct(Point=eval.Point)  # -> XComponent, YComponent, ZComponent
eval_2 = EvaluateCurve(Curve=reparameterize(crv), Parameter=addition)  # -> Point, Tangent, Angle
addition_2 = Addition(A=Slider(9, range=0..100), B=pdecon.ZComponent)
pt = ConstructPoint(XCoordinate=pdecon.XComponent, YCoordinate=pdecon.YComponent, ZCoordinate=addition_2)
c_script = CSharpScript(loc=pt, tar=eval_2.Point)  # -> out, A; inputs loc: Point3d, tar: Point3d
# ---------- c_script: C# ----------
    //get current viewport
    vp = Rhino.RhinoDoc.ActiveDoc.Views.ActiveView.ActiveViewport;
    //set new camera
    vp.SetCameraLocations(tar, loc);
# ---------- c_script: C# additional code ----------
  Rhino.Display.RhinoViewport vp; //used to get and set rhino camera properties
# ---------- end c_script ----------
