# Grasshopper definition 生命游戏.gh (Grasshopper 0.9.76)
# plug-ins: Python Interpreter, Agent

number_slider = Slider(150, range=0..150)
timer = Timer(TimerInterval=500, Target=python)
python = PythonScript(row=number_slider, col=number_slider, rate=Slider(0.31, range=0..1), seed=Slider(22, range=0..100), bool=Toggle(True))  # -> out, a; inputs row: Int32, col: Int32, bool: Boolean
# ---------- python: Python ----------
#_*_coding:UTF-8_*_
#!/usr/bin/python

#Author :CPF
#Datatime :2017-07-03
#copyright

import random
import Rhino.Geometry as rg

class Graph:
    """
    一个二维向量用来存储细胞的的状态值,死为0,生为1.
    """
    DEATH = 0
    LIVE = 1
    def __init__(self,row,col):
        """
        row行，col列，默认状态值为死
        """
        row,col = int(row),int(col)
        self.vec2 = [[Graph.DEATH for i in range(col)] for k in range(row)]
        self._row = row
        self._col = col
        
    @property
    def row (self):
        return self._row
        
    @property
    def col(self):
        return self._col
        
    def reset(self,live_rate):
        """
        重设细胞的的状态,live_rate为细胞的存活几率。
        """
        for i in range(self._row):
            for k in range(self._col):
                rand_value = random.uniform(0,1)
                if live_rate > rand_value:
                    self.vec2[i][k] = Graph.LIVE
                else:
                    self.vec2[i][k] = Graph.DEATH
        
    def neighbor_live_count(self,row,col):
        """
        获取第row行，第col列的相邻的8个细胞的存活细胞数目
        """
        count = 0
        neighbor = {'right_top':(-1,-1),'top':(-1,0),'left_top':(-1,1),
                    'right':(0,-1),'lift':(0,1),
                    'right_buttom':(1,-1),'buttom':(1,0),'left_buttom':(1,1)}
        for value in neighbor.values():
            if row == 0:
                neig_row = row + value[0]
            else:
                neig_row = (row + value[0])%self.row
            if col == 0:
                neig_col = col + value[1]
            else:
                neig_col = (col + value[1])%self.col
            if self.vec2[neig_row][neig_col] == Graph.LIVE:
                count = count + 1
        return count
        
    def updates(self):
        """
        先获取上一步周围细胞的存活数量，再更新细胞的生命值
        """
        lists = []
        for i in range(self._row):
            row_list = []
            for k in range(self.col):
                count = self.neighbor_live_count(i,k)
                row_list.append(count)
            lists.append(row_list)
            
        for i in range(self.row):
            for k in range(self.col):
                count = lists[i][k]
                print count
                if count == 3 :
                    self.vec2[i][k] = Graph.LIVE
                elif count != 2:
                    self.vec2[i][k] = Graph.DEATH

    def display(self):
        """
        显示细胞状态
        """
        state =[]
        for row in self.vec2:
            state.extend(row)
        return state

if bool:
    random.seed(seed)
    graph = Graph(row,col)
    graph.reset(rate)
else:
    graph.updates()
    a = graph.display()
# ---------- end python ----------
sqgrid = Square(
    Plane=PlaneXY(0, 0, 0),
    Size=Slider(2, range=0..10),
    ExtentX=expr("x-1", number_slider),
    ExtentY=expr("x-1", number_slider))  # -> Cells, flatten(Points)
neighbors = GetNeighborsInRadius()
dispatch = Dispatch(List=sqgrid.Points, DispatchPattern=python.a)  # -> ListA, ListB
cir = Circle(Plane=dispatch.ListA, Radius=1)
number_slider_2 = Slider(2, range=0..10)  # disabled
circle = CircleCNR(Normal=Vector(0, 0, 1), Radius=number_slider_2)  # disabled
python_2 = PythonScript()  # -> out, a
# ---------- python_2: Python ----------
def neighbor_live_count(row,col):
    """
    获取第row行，第col列的相邻的8个细胞的存活细胞数目
    """
    count = 0
    #print row ,col
    neighbor = {'right_top':(-1,-1),'top':(-1,0),'left_top':(-1,1),
                'right':(0,-1),'lift':(0,1),
                'right_buttom':(1,-1),'buttom':(1,0),'left_buttom':(1,1)}
    for value in neighbor.values():
        print value
        if row == 0:
            row = row + value[0]
        else:
            row = (row + value[0])%100
        if col == 0:
            col = col + value[1]
        else:
            col = (col + value[1])%100
        print row ,col


    
a = neighbor_live_count(0,0)
# ---------- end python_2 ----------
