# Grasshopper definition 用Python写场line.gh (Grasshopper 0.9.76)
# plug-ins: Python Interpreter

crv = Curve(simplify(graft([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])))
offset = Offset(Curve=crv, Distance=0.5, Plane=PlaneXY(0, 0, 0), Corners=1)  # -> simplify(Curve)
loft = Loft(Curves=[offset, crv], Options={Adjust=False, Closed=False, LoftEnds=0, LoftSimp=0, LoftType=0, Rebuild=10, Refit=0.01})
explode = Explode(Curve=crv, Recursive=True)  # -> flatten(Segments), Vertices
number_slider = Slider(16, range=0..100)
# 吸引力系数
number_slider_2 = Slider(16, range=0..100)
pop2d = Populate2D(
    Region={Plane=PlaneXY(-25.56845877, -18.07337497, 0), Size=Domain2(u=0..42.27199348, v=0..43.10906266)},
    Count=number_slider,
    Seed=1)
box = Box({Plane=Plane(origin=(-57.38393924, -37.05758215, 0), x=(0, 1, 0), y=(1, 0, 0)), X=Domain(0, 82.50338897), Y=Domain(0, 147.1452195), Z=Domain(-1, 0)})
pop2d_2 = Populate2D(
    Region={Plane=PlaneXY(28.54653338, -17.05535808, 0), Size=Domain2(u=0..21.26376004, v=0..36.14839207)},
    Count=number_slider,
    Seed=1)
line = Line(Line((-54.89235633, -34.68085105, 0), (98.41935358, -36.80722705, 0)))
pop2d_3 = Populate2D(
    Region={Plane=PlaneXY(-28.29980522, -98.13438968, 0), Size=Domain2(u=0..25.94178725, v=0..39.97586888)},
    Count=number_slider,
    Seed=1)
pop2d_4 = Populate2D(
    Region={Plane=PlaneXY(10.18760046, -100.0481281, 0), Size=Domain2(u=0..40.40114408, v=0..43.80334569)},
    Count=number_slider,
    Seed=1)
merge = Merge(Data1=pop2d, Data2=pop2d_2, Data3=pop2d_3, Data4=pop2d_4)
pt = Point(merge)
mergef = MergeFields()
timer = Timer(TimerInterval=50, Target=python_2)
python = PythonScript()  # -> Out, A
python_2 = PythonScript(pos=pt, line_field=line, lines=explode.Segments, box=box, num=number_slider_2, Toogle=Toggle(False))  # -> out, a, L; inputs pos: list of Point3d, line_field: list of Line, lines: list of Line, box: Box, num: Int32, Toogle: Boolean
# ---------- python_2: Python ----------
from Grasshopper.Kernel.Types import GH_LineCharge  
from Rhino.Geometry import Point3d
from Rhino.Geometry import Vector3d 
from  scriptcontext import sticky as st

class Mover(object):
    def __init__(self,pos):
        self.pos=pos  #定义基本类的位置属性。

L=[]
V=[]
for i in range(len(pos)):
    names='move%d'%i 
    if names not in st:
        st[names]=Mover(pos[i])
        gH_LineCharge =  GH_LineCharge()  #初始化墙体的磁场线
        gH_LineCharge.Charge = 1 
        gH_LineCharge.Limits = box
        
        gH_LineCharge2 =  GH_LineCharge()  #初始化吸引的磁场线
        gH_LineCharge2.Charge = -num
        gH_LineCharge2.Limits = box
    if Toogle:
        a=Point3d(0,0,0)
        for line in lines:
            gH_LineCharge.Segment = line
            b=gH_LineCharge.Force(st[names].pos)
            a=Point3d.Add(a,b)
        for line in line_field:
            gH_LineCharge2.Segment = line
            b=gH_LineCharge2.Force(st[names].pos)
            a=Point3d.Add(a,b)
        a=Vector3d(a.X,a.Y,0)
        a.Unitize()
        st[names].pos=Point3d.Add(st[names].pos,a)
        L.append(st[names].pos) 
    else:
        del st[names]
# ---------- end python_2 ----------
lcharge = LineCharge(Charge=1)
pt_2 = Point(python_2.L)
sph = Sphere(Base=pt_2, Radius=Slider(1, range=0..1))
