# Grasshopper definition 用Python写场point.gh (Grasshopper 0.9.76)
# plug-ins: Python Interpreter

crv = Curve(simplify(graft([<curve referenced from the Rhino model> x3])))
offset = Offset(Curve=crv, Distance=0.5, Plane=PlaneXY(0, 0, 0), Corners=1)  # -> simplify(Curve)
number_slider = Slider(16, range=0..100)
explode = Explode(Curve=crv, Recursive=True)  # -> flatten(Segments), Vertices
loft = Loft(Curves=[offset, crv], Options={Adjust=False, Closed=False, LoftEnds=0, LoftSimp=0, LoftType=0, Rebuild=10, Refit=0.01})
pop2d = Populate2D(
    Region={Plane=PlaneXY(-25.56845877, -18.07337497, 0), Size=Domain2(u=0..42.27199348, v=0..43.10906266)},
    Count=number_slider,
    Seed=1)
pop2d_2 = Populate2D(
    Region={Plane=PlaneXY(28.54653338, -17.05535808, 0), Size=Domain2(u=0..21.26376004, v=0..36.14839207)},
    Count=number_slider,
    Seed=1)
line = Line(explode.Segments)
box = Box({Plane=Plane(origin=(-57.38393924, -37.05758215, 0), x=(0, 1, 0), y=(1, 0, 0)), X=Domain(0, 82.50338897), Y=Domain(0, 147.1452195), Z=Domain(-1, 0)})
pt = Point(Point(-7.199426721, -31.46726632, 0))
merge = Merge(Data1=pop2d, Data2=pop2d_2)
timer = Timer(TimerInterval=50, Target=python)
pt_2 = Point(merge)
python = PythonScript(pos=pt_2, point=pt, lines=line, box=box, num=Slider(12, range=0..100), Toogle=Toggle(False))  # -> out, a, L, point_field; inputs pos: list of Point3d, point: Point3d, lines: list of Line, box: Box, num: Int32, Toogle: Boolean
# ---------- python: Python ----------
from Grasshopper.Kernel.Types import GH_LineCharge
from Grasshopper.Kernel.Types import GH_PointCharge
from Rhino.Geometry import Point3d
from Rhino.Geometry import Vector3d 
from  scriptcontext import sticky as st

class Mover(object):
    def __init__(self,pos):
        self.pos=pos  #定义基本类的位置属性。


L=[]
V=[]
for i in range(len(pos)):
    names='move%d'%i 
    if names not in st:
        st[names]=Mover(pos[i])
        gH_LineCharge =  GH_LineCharge()
        gH_LineCharge.Charge = 1
        gH_LineCharge.Limits = box
        
        gH_PointCharge = GH_PointCharge();
        gH_PointCharge.Location = point;
        gH_PointCharge.Charge = -num;
        gH_PointCharge.Decay = 2;
        gH_PointCharge.Limits = box 

    if Toogle:
        a=Point3d(0,0,0)
        for line in lines:
            gH_LineCharge.Segment = line
            b=gH_LineCharge.Force(st[names].pos)
            a=Point3d.Add(a,b)
        point_field=gH_PointCharge.Force(st[names].pos)
        a=Point3d.Add(a,point_field)
        a=Vector3d(a.X,a.Y,0)
        a.Unitize()
        st[names].pos=Point3d.Add(st[names].pos,a)
        postion=st[names].pos 
        vector=a
        L.append(postion) 
        V.append(vector) 
    else:
        del st[names]
# ---------- end python ----------
pt_3 = Point(python.L)
sph = Sphere(Base=pt_3, Radius=Slider(1, range=0..1))
