# Grasshopper definition 第十讲01.gh (Grasshopper 0.9.76)
# plug-ins: Python Interpreter

construct_domain = ConstructDomain(DomainStart=Slider(2, range=0..10), DomainEnd=Slider(8, range=0..10))

# ---- group: 定义函数
python = PythonScript()  # -> out, a; disabled
# ---------- python: Python ----------
import MyFirstFunction as fun

a = fun.My_Abs(4)
b = fun.My_Add(4,6)
# ---------- end python ----------
python_2 = PythonScript()  # -> out, a; disabled
# ---------- python_2: Python ----------
def My_Abs(x):
    if (x>=0):
        return x
    else:
        return -x

a = My_Abs(-4)
print a

b = My_Abs(4)
print b

c = My_Abs(0)
print c
# ---------- end python_2 ----------
python_3 = PythonScript()  # -> out, a; disabled
# ---------- python_3: Python ----------
import datetime as dt

def ShowNowTime():
    now = dt.datetime.now()
    #这里的智能提示没有datetime
    print now

a = ShowNowTime()
#因为函数没有return出返回值，所以调用函数生成的是空值
# ---------- end python_3 ----------
python_4 = PythonScript()  # -> out, a; disabled
# ---------- python_4: Python ----------
def My_Abs(x):
    """这是我的第一个函数
    """
    if (x>=0):
        return x
    else:
        return -x

a = My_Abs(-4)
print a

b = My_Abs(4)
print b

c = My_Abs(0)
print c

print My_Abs.__doc__
#上面一句话是返回函数定义里面的帮助文档，我们写函数的时候
#经常写一句提示语来介绍函数，这样方便别人使用
# ---------- end python_4 ----------
panel = Panel(python_3.a)
python_5 = PythonScript()  # -> out, a; disabled
# ---------- python_5: Python ----------
import datetime as dt

def ShowNowTime():
    now = dt.datetime.now()
    #这里的智能提示没有datetime
    print now
    return now

a = ShowNowTime()
#因为函数有return出返回值，所以a等于现在的系统时间
# ---------- end python_5 ----------
panel_2 = Panel(python_5.a)

# ---- group: 案列
crv = Curve(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)
crv_2 = Curve(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)
python_6 = PythonScript(crv0=crv_2, crv1=crv, count=Slider(20, range=0..100), scale=Slider(0.2443, range=0..1))  # -> out, a; inputs count: Int32
# ---------- python_6: Python ----------
import rhinoscriptsyntax as rs

rs.EnableRedraw(False)

#LOFT (Functions/Variation)
#RESEARCHROOM

def LoftDivideCrvs (curve1,curve2,count,scale):
    listCrv1 = [];listCrv2 = [];srf = []
    #分号是结束符
    pts1 = rs.DivideCurve(curve1,count)
    pts2 = rs.DivideCurve(curve2,count)
    
    for i in xrange (0,len(pts1)):
        crvList = []
        midPt = (pts1[i]+pts2[i])/2
        #通过两个point3d点相加除2求中点
        distance = rs.Distance(pts1[i],pts2[i])
        if (scale>1):
            new_midpt = rs.AddPoint(midPt.X,midpt.Y,distance/scale)
        else:
            new_midpt = rs.AddPoint(midPt.X,midPt.Y,distance*scale)
        crvList.extend((pts1[i],new_midpt,pts2[i]))
        #通过重点Z值变化生成的曲线点，midPt.X是因为Point3d类型可以用过X,Y,Z提取坐标值。后面来个案例。
        curs = rs.AddInterpCurve(crvList,3,3)
        listCrv1.append(curs)
        line = rs.AddLine(pts1[i],pts2[i])
        listCrv2.append(line)
        
    for j in xrange(0,len(listCrv1)-1):
        Loft_Surface = rs.AddLoftSrf([listCrv1[j],listCrv2[j+1]],None,None,3)[0]
        #放样生成曲面，注意返回值类型。
        srf.append(Loft_Surface)
    return srf

a = LoftDivideCrvs(crv0,crv1,count,scale)
# ---------- end python_6 ----------
preview = CustomPreview(
    Geometry=python_6.a,
    Shader={ambient=RGB(0, 0, 0), diffuse=RGB(255, 105, 180), emission=RGB(76, 32, 54), shine=0.5, specular=RGB(255, 255, 255), transparency=0})

# ----
crv_3 = Curve(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)
crv_4 = Curve(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)
series = Series(Start=0, Step=1, Count=10)

# ---- group: 调用函数
python_7 = PythonScript()  # -> out, a; disabled
# ---------- python_7: Python ----------
import rhinoscriptsyntax as rs

a = rs.AddPoint(0,0,0)
# ---------- end python_7 ----------

# ---- group: 为什么需要函数
python_8 = PythonScript()  # -> out, a; disabled
# ---------- python_8: Python ----------
import math

#比如我们要求计算一个圆的面积，我们知道公式是π*r²

Area_C1 = math.pi*(5**2)
print "半径为5的圆的面积为："+str(Area_C1)
#求半径为5的圆面积

Area_C2 = math.pi*(7**2)
print "半径为7的圆的面积为："+str(Area_C2)
#求半径为7的圆面积

Area_C3 = math.pi*(9**2)
print "半径为9的圆的面积为："+str(Area_C3)
#求半径为9的圆面积

"""
这样重复性很高的，如果我们突然接到要求说这个圆计算的面积要求用
3.2，现在我们是崩溃的。。全部要改一遍，
有没有啥办法可以让我们很方便修改很少量的参数就可以改变全部呢
这样函数就诞生，把重复性很高的代码封装到一个函数里。
方便重复使用。

"""

print 100*"#"

def Area(radius):
    return math.pi*radius**2

print "半径为5的圆的面积为："+str(Area(5))
print "半径为7的圆的面积为："+str(Area(7))
print "半径为9的圆的面积为："+str(Area(9))

print 100*"#"

#现在我们接到求圆面积里面的pi用3.2计算。
def Area(radius):
    return 3.2*radius**2

print "半径为5的圆的面积为："+str(Area(5))
print "半径为7的圆的面积为："+str(Area(7))
print "半径为9的圆的面积为："+str(Area(9))
#这样我们很轻松就搞定

#也可以一开始我们这样定义函数

def My_Area(radius,My_Pi = math.pi):
    return My_Pi*radius**2
"""
在定义函数时设置默认参数，这样最方便，用户不输入pi就默认math.pi
如果用户输入pi参数，函数就用用户输入的参数计算,

这里要注意一点，默认参数必须在非默认参数后面。后面我们会详细讲
"""
print 50*"#"

print "半径为5的圆的面积为："+str(My_Area(5))
print "半径为7的圆的面积为："+str(My_Area(7))
print "半径为9的圆的面积为："+str(My_Area(9))

print 50*"#"

print "半径为5的圆的面积为："+str(My_Area(5,3.2))
print "半径为7的圆的面积为："+str(My_Area(7,3.2))
print "半径为9的圆的面积为："+str(My_Area(9,3.2))
# ---------- end python_8 ----------

# ----
python_script = PythonScript(cur0=crv_4, cur1=crv_3, count=Slider(16, range=0..100), scale=Slider(4, range=0..10), domain=construct_domain)  # -> out, a
# ---------- python_script: Python ----------
import rhinoscriptsyntax as rs
import math 

def my_map(xlist,domain):
    new_list=[]
    domain0=domain[0]
    domain1=domain[1]
    mi=min(xlist)
    ma=max(xlist)
    step=(domain1-domain0)/(ma-mi)
    for i in range(len(xlist)):
        new=(xlist[i]-mi)*step+domain0
        new_list.append(new)
    return new_list



def loft_Divide_Curve(cur0,cur1,count,scale,domain):
    '''
    放样线
    '''
    listCrv1 = [];listCrv2 = [];srfs= [];dis=[]
    pts1=rs.DivideCurve(cur0,count)
    pts2=rs.DivideCurve(cur1,count)
    for i in range(len(pts1)):
        distance=rs.Distance(pts1[i],pts2[i])
        dis.append(distance)
    new_dis=my_map(dis,domain)
    for i in range(len(pts1)):
        midPt=(pts1[i]+pts2[i])/2
        
        if scale>1:
            new_midPt=[midPt.X,midPt.Y,new_dis[i]*scale]
        else:
            new_midPt=[midPt.X,midPt.Y,new_dis[i]/scale]
            
        cur2pt=[pts1[i],new_midPt,pts2[i]]
        curve1=rs.AddInterpCurve(cur2pt,3,3)
        curve2=rs.AddLine(pts1[i],pts2[i])
        listCrv1.append(curve1)
        listCrv2.append(curve2)
    for i in range(len(listCrv1)-1):
        srf=rs.AddLoftSrf([listCrv1[i],listCrv2[i+1]])[0]
        srfs.append(srf)
    return srfs
    
if domain is None:
    domain=[0,1]
a=loft_Divide_Curve(cur0,cur1,count,scale,domain)
# ---------- end python_script ----------

python_9 = PythonScript()  # -> out, a; disabled
# ---------- python_9: Python ----------
def Add(x,y):
    return x+y

a = Add
print a

b = Add(2,3)
print b
# ---------- end python_9 ----------

python_script_2 = PythonScript(Source=series)  # -> out, a; inputs Source: list of Int32
# ---------- python_script_2: Python ----------
import math 

def my_map(xlist,domain):
    new_list=[]
    domain0=domain[0]
    domain1=domain[1]
    mi=min(xlist)
    ma=max(xlist)
    step=(domain1-domain0)/(ma-mi)
    for i in range(len(xlist)):
        new=(xlist[i]-mi)*step+domain0
        new_list.append(new)
    return new_list

if domain is None:
    domain=[0,1]
a=my_map(Source,domain)
# ---------- end python_script_2 ----------
panel_3 = Panel(python_script.a)
panel_4 = Panel(python_script_2.a)

# ---- group: 求点坐标
pt = Point(Point(65, -27, 0))
python_10 = PythonScript(x=pt)  # -> out, a, b, c
# ---------- python_10: Python ----------
import rhinoscriptsyntax as rs
print type(x)
a,b,c = rs.PointCoordinates(x)
# ---------- end python_10 ----------
pdecon = Deconstruct(Point=pt)  # -> XComponent, YComponent, ZComponent
python_11 = PythonScript(x=pt)  # -> out, a, b, c; inputs x: Point3d
# ---------- python_11: Python ----------
print type(x)
a,b,c = x.X,x.Y,x.Z
# ---------- end python_11 ----------
panel_5 = Panel([pdecon.XComponent, pdecon.YComponent, pdecon.ZComponent])
panel_6 = Panel([python_11.a, python_11.b, python_11.c])
panel_7 = Panel([python_10.a, python_10.b, python_10.c])
