# Grasshopper definition 遗传算法.gh (Grasshopper 0.9.76)

number_slider = Slider(105, range=0..360)
crv = Curve(<curve referenced from the Rhino model>)
rotate = Rotate(Geometry=crv, Angle=degrees(number_slider), Plane=PlaneXY(0, 0, 0))  # -> Geometry, Transform
bbox = BoundingBox(Content=rotate.Geometry, Plane=PlaneXY(0, 0, 0))  # -> Box, Box_2
wires = BrepWireframe(Brep=bbox.Box, Density=-1)
join = JoinCurves(Curves=wires, Preserve=False)
galapagos = Galapagos(fitness=area, gene=number_slider)
area = Area(Geometry=join)  # -> Area, Centroid
