# Grasshopper definition 鼠标控制干扰点IIII.gh (Grasshopper 0.9.76)

srf = Surface(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)
c_script = CSharpScript()  # -> out, A; inputs x: Boolean
# ---------- c_script: C# ----------
    Script_Instance.FeedBack feed = new Script_Instance.FeedBack();
    comp = Component;
    A = line;
# ---------- c_script: C# additional code ----------
  public static Line line = new Line();
  public static IGH_Component comp;

  public class FeedBack : Rhino.UI.MouseCallback
  {
    public FeedBack()
    {
      this.Enabled = true;
    }
    protected override void OnMouseMove(Rhino.UI.MouseCallbackEventArgs e)
    {
      Rhino.Display.RhinoView v = e.View;
      line = v.ActiveViewport.ClientToWorld(e.ViewportPoint);
      comp.ExpireSolution(true);
      e.Cancel = true;
    }
  }
# ---------- end c_script ----------
mesh_uv = MeshSurface(Surface=srf, UCount="20", VCount="20", Overhang=True, Equalize=False)
faceb = FaceBoundaries(Mesh=mesh_uv)
blx = BrepLine(Brep=srf, Line=c_script.A, LimitToFirst=False)  # -> Curves, Points
pcen = PolygonCenter(Polyline=faceb)  # -> CenterV, CenterE, CenterA
null = NullItem(Item=blx.Points)  # -> NullFlags, InvalidFlags, Description
xy = XYPlane(Origin=Point(0, 0, 0))
cull = CullPattern(List=c_script.A, CullPattern=null.NullFlags)
plx = LinePlane(Line=cull, Plane=xy)  # -> Point, ParamL, ParamP
p_n_c = PickNChoose(Pattern=null.NullFlags, Stream0=blx.Points, Stream1=plx.Point)
dist = Distance(PointA=p_n_c, PointB=pcen.CenterV)
scale = Scale(Geometry=faceb, Center=pcen.CenterV, Factor="0.5")  # -> Geometry, Transform
explode = Explode(Curve=faceb, Recursive=True)  # -> Segments, Vertices
explode_2 = Explode(Curve=scale.Geometry, Recursive=True)  # -> Segments, Vertices
rulesrf = RuledSurface(CurveA=explode.Segments, CurveB=explode_2.Segments)
join = BrepJoin(Breps=rulesrf)  # -> Breps, Closed
smesh = SimpleMesh(Brep=join.Breps)
weld = WeldMesh(Mesh=smesh, Angle=3.141592654)
panel = Panel("""2
3
5
7""")
demesh = DeconstructMesh(Mesh=weld)  # -> Vertices, Faces, Colours, Normals
expression = Expression(x=dist, Expression="2/ (1 + x)")
item = ListItem(List=demesh.Vertices, Index=panel, Wrap=True)
scale_2 = Scale(Geometry=item, Center=graft(pcen.CenterV), Factor=graft(expression))  # -> Geometry, Transform
replace = ReplaceItems(List=demesh.Vertices, Item=scale_2.Geometry, Indices=panel, Wrap=False)
conmesh = ConstructMesh(Vertices=replace, Faces=demesh.Faces)
